# Dynamo graph GridBowlSurfaceDirection_3.4.1.dyn (Dynamo 3.4.1.7055)

code_block = CodeBlock { 0; }
depth_and_width = IntegerSlider(23, range=5..100 step 1)
code_block_2 = CodeBlock { 1; }
range = Range(start=code_block, end=depth_and_width, step=code_block_2)
byCoordinates = Point.ByCoordinates(x=range)
code_block_3 = CodeBlock { 1; }
byCoordinates_2 = Vector.ByCoordinates(y=code_block_3)
lastItem = List.LastItem(list=range)
byStartPointDirectionLength = Line.ByStartPointDirectionLength(startPoint=byCoordinates, direction=byCoordinates_2, length=lastItem)
byCoordinates_3 = Point.ByCoordinates(y=range)
code_block_4 = CodeBlock { 1; }
byCoordinates_4 = Vector.ByCoordinates(x=code_block_4)
byStartPointDirectionLength_2 = Line.ByStartPointDirectionLength(startPoint=byCoordinates_3, direction=byCoordinates_4, length=lastItem)
join = List.Join(list0=byStartPointDirectionLength, list1=byStartPointDirectionLength_2)
code_block_5 = CodeBlock { 2; }
div = depth_and_width / code_block_5
grid_direction = DoubleSlider(5, range=2..12 step 0.1)
byCoordinates_5 = Point.ByCoordinates(x=div, y=div, z=grid_direction)
code_block_6 = CodeBlock { 2; }
pointsAtEqualChordLength = Curve.PointsAtEqualChordLength(curve=join, divisions=code_block_6)
byTwoPoints = Vector.ByTwoPoints(start=byCoordinates_5, end=pointsAtEqualChordLength)
flatten = List.Flatten(list=byTwoPoints)
X = Vector.X(vector=flatten)
Y = Vector.Y(vector=flatten)
Z = Vector.Z(vector=flatten)
code_block_7 = CodeBlock(x=X, y=Y, z=Z) { -x; -y; -z; }
byCoordinates_6 = Vector.ByCoordinates(x=code_block_7.out0, y=code_block_7.out1, z=code_block_7.out2)
extrude = Curve.Extrude(curve=join, direction=byCoordinates_6)
surface_thickness = DoubleSlider(0.15, range=0.01..0.9 step 0.01)
code_block_8 = CodeBlock { 1; }
thicken = Surface.Thicken(surface=extrude, thickness=surface_thickness, both_sides=code_block_8)
byUnion = Solid.ByUnion(solids=thicken)
sphere_cut_height = DoubleSlider(13.8, range=2..15 step 0.1)
byCoordinates_7 = Point.ByCoordinates(x=div, y=div, z=sphere_cut_height)
sphere_cut_radius = DoubleSlider(12.7, range=2..15 step 0.1)
byCenterPointRadius = Sphere.ByCenterPointRadius(centerPoint=byCoordinates_7, radius=sphere_cut_radius)
split = Geometry.Split(geometry=byUnion, other=byCenterPointRadius)
code_block_9 = CodeBlock(x=split) { x[0]; }
