# Dynamo graph GridBowl_3.4.1.dyn "Thing_3.4.1" (Dynamo 3.4.1.7055)

differenceAll = Solid.DifferenceAll()  # unwired: solid, others
code_block = CodeBlock { 0; }
depth_and_width = IntegerSlider(14, range=5..100 step 1)
code_block_2 = CodeBlock { 1; }
range = Range(start=code_block, end=depth_and_width, step=code_block_2)
byCoordinates = Point.ByCoordinates(x=range)
code_block_3 = CodeBlock { 1; }
byCoordinates_2 = Vector.ByCoordinates(y=code_block_3)
lastItem = List.LastItem(list=range)
byStartPointDirectionLength = Line.ByStartPointDirectionLength(startPoint=byCoordinates, direction=byCoordinates_2, length=lastItem)
byCoordinates_3 = Point.ByCoordinates(y=range)
code_block_4 = CodeBlock { 1; }
byCoordinates_4 = Vector.ByCoordinates(x=code_block_4)
byStartPointDirectionLength_2 = Line.ByStartPointDirectionLength(startPoint=byCoordinates_3, direction=byCoordinates_4, length=lastItem)
join = List.Join(list0=byStartPointDirectionLength, list1=byStartPointDirectionLength_2)
height = IntegerSlider(3, range=1..10 step 1)
byCoordinates_5 = Vector.ByCoordinates(z=height)
extrude = Curve.Extrude(curve=join, direction=byCoordinates_5)
surface_thickness = DoubleSlider(0.2, range=0.1..1 step 0.1)
code_block_5 = CodeBlock { 1; }
thicken = Surface.Thicken(surface=extrude, thickness=surface_thickness, both_sides=code_block_5)
byUnion = Solid.ByUnion(solids=thicken)
code_block_6 = CodeBlock { 2; }
div = depth_and_width / code_block_6
sphere_cut_height = DoubleSlider(10.2, range=2..12 step 0.1)
byCoordinates_6 = Point.ByCoordinates(x=div, y=div, z=sphere_cut_height)
sphere_cut_radius = DoubleSlider(10, range=2..12 step 0.1)
byCenterPointRadius = Sphere.ByCenterPointRadius(centerPoint=byCoordinates_6, radius=sphere_cut_radius)
split = Geometry.Split(geometry=byUnion, other=byCenterPointRadius)
code_block_7 = CodeBlock(x=split) { x[0]; }
