# Dynamo graph NurbsCurvePencilHolder_3.4.1.dyn "NurbsCurvePencilHolder" (Dynamo 3.4.1.7055)

# note: 3.4.1
overall_size = IntegerSlider(11, range=3..100 step 1)
byCoordinates = Point.ByCoordinates(z=overall_size)
code_block = CodeBlock { 2; }
div = overall_size / code_block
byCenterPointRadius = Circle.ByCenterPointRadius(centerPoint=byCoordinates, radius=div)
byCoordinates_2 = Point.ByCoordinates(y=div, z=overall_size)
code_block_2 = CodeBlock { 0; }
byCoordinates_3 = Point.ByCoordinates(y=overall_size, z=code_block_2)
y_amount = IntegerSlider(17, range=3..100 step 1)
seed = IntegerSlider(39, range=3..100 step 1)
code_block_3 = CodeBlock(x=seed) { x/2; }
randomList = Math.RandomList(amount=y_amount, value1=div, value2=overall_size, seed=code_block_3)
sort = List.Sort(list=randomList)
reverse = List.Reverse(list=sort)
z_amount = IntegerSlider(18, range=3..100 step 1)
code_block_4 = CodeBlock { 0; }
randomList_2 = Math.RandomList(amount=z_amount, value1=code_block_4, value2=overall_size, seed=seed)
sort_2 = List.Sort(list=randomList_2)
byCoordinates_4 = Point.ByCoordinates(y=reverse, z=sort_2)
addItemToFront = List.AddItemToFront(item=byCoordinates_3, list=byCoordinates_4)
addItemToEnd = List.AddItemToEnd(item=byCoordinates_2, list=addItemToFront)
nurbscurve_degree = IntegerSlider(2, range=1..20 step 1)
byControlPoints = NurbsCurve.ByControlPoints(points=addItemToEnd, degree=nurbscurve_degree)
code_block_5 = CodeBlock { 360; }
byRevolve = Surface.ByRevolve(profile=byControlPoints, sweepAngle=code_block_5)
byRevolve_2 = Solid.ByRevolve()  # unwired: profile
byRevolve_3 = Solid.ByRevolve()  # unwired: profile
code_block_6 = CodeBlock {  }
exportToSAT = ExportWithUnits(SelectedExportedUnitsSource=[0, 1, 2, 3, 5, 4], SelectedExportedUnit=0)  # unwired: geometry
byRevolve_4 = Surface.ByRevolve(profile=byControlPoints)
integer_slider = IntegerSlider(1, range=1..10 step 1)
code_block_7 = CodeBlock { 0; }
thicken = Surface.Thicken(surface=byRevolve_4, thickness=integer_slider, both_sides=code_block_7)
code_block_8 = CodeBlock { 1; }
byCoordinates_5 = Vector.ByCoordinates(x=code_block_8)
byOriginNormal = Plane.ByOriginNormal(normal=byCoordinates_5)
mirror = Geometry.Mirror(geometry=thicken, mirrorPlane=byOriginNormal)
byCoordinates_6 = Point.ByCoordinates()
byCenterPointRadius_2 = Circle.ByCenterPointRadius(centerPoint=byCoordinates_6, radius=overall_size)
patch = Curve.Patch(curve=byCenterPointRadius_2)
thicken_2 = Surface.Thicken(surface=patch, thickness=integer_slider, both_sides=code_block_7)
join = List.Join(list0=mirror, list1=thicken, list2=thicken_2)
byUnion = Solid.ByUnion(solids=join)
string = StringInput("D:\OneDrive\My Stuff\GitHub\3d-printing-stuff\Dynamo Models\NurbsCurvePencilHolder.sat")
exportToSAT_2 = Geometry.ExportToSAT(geometry=byUnion, filePath=string)
