# Dynamo graph VoronoiCylinder_3.4.1.dyn (Dynamo 3.4.1.7055)

uv_amount = DoubleSlider(671, range=1..800 step 1)
code_block = CodeBlock { 0; 1; }
seed1 = DoubleSlider(1, range=1..100 step 1)
randomList = Math.RandomList(amount=uv_amount, value1=code_block.out0, value2=code_block.out1, seed=seed1)
seed2 = DoubleSlider(42, range=1..100 step 1)
randomList_2 = Math.RandomList(amount=uv_amount, value1=code_block.out0, value2=code_block.out1, seed=seed2)
byCoordinates = UV.ByCoordinates(u=randomList, v=randomList_2)
cylinder_radius = IntegerSlider(10, range=4..100 step 1)
cylinder_height = IntegerSlider(13, range=4..100 step 1)
byRadiusHeight = Cylinder.ByRadiusHeight(radius=cylinder_radius, height=cylinder_height)
explode = Geometry.Explode(geometry=byRadiusHeight)
code_block_2 = CodeBlock(x=explode) { x[0]; }
byParametersOnSurface = Tessellation.Voronoi.ByParametersOnSurface(uvs=byCoordinates, face=code_block_2)
startPoint = Curve.StartPoint(curve=byParametersOnSurface)
endPoint = Curve.EndPoint(curve=byParametersOnSurface)
list_create = List.Create(item0=startPoint, item1=endPoint)
transpose = List.Transpose(lists=list_create)
doesIntersect = Geometry.DoesIntersect(geometry=code_block_2, other=transpose@L2)
anyFalse = List.AnyFalse(list=doesIntersect@L2)
filterByBoolMask = List.FilterByBoolMask(list=transpose, mask=anyFalse)
code_block_3 = CodeBlock { 0; }
getItemAtIndex = List.GetItemAtIndex(list=filterByBoolMask.out@L2, index=code_block_3)
X = Point.X(point=getItemAtIndex)
code_block_4 = CodeBlock { 1; }
getItemAtIndex_2 = List.GetItemAtIndex(list=filterByBoolMask.out@L2, index=code_block_4)
X_2 = Point.X(point=getItemAtIndex_2)
list_create_2 = List.Create(item0=X, item1=X_2)
transpose_2 = List.Transpose(lists=list_create_2)
sort = List.Sort(list=transpose_2@L2)
code_block_5 = CodeBlock { 0; 1; }
getItemAtIndex_3 = List.GetItemAtIndex(list=sort@L2, index=code_block_5.out1)
getItemAtIndex_4 = List.GetItemAtIndex(list=sort@L2, index=code_block_5.out0)
sub = getItemAtIndex_3 - getItemAtIndex_4
code_block_6 = CodeBlock { 2; }
div = cylinder_radius / code_block_6
gt = sub > div
Y = Point.Y(point=getItemAtIndex)
Y_2 = Point.Y(point=getItemAtIndex_2)
list_create_3 = List.Create(item0=Y, item1=Y_2)
transpose_3 = List.Transpose(lists=list_create_3)
sort_2 = List.Sort(list=transpose_3@L2)
code_block_7 = CodeBlock { 0; 1; }
getItemAtIndex_5 = List.GetItemAtIndex(list=sort_2@L2, index=code_block_7.out1)
getItemAtIndex_6 = List.GetItemAtIndex(list=sort_2@L2, index=code_block_7.out0)
sub_2 = getItemAtIndex_5 - getItemAtIndex_6
gt_2 = sub_2 > div
list_create_4 = List.Create(item0=gt, item1=gt_2)
transpose_4 = List.Transpose(lists=list_create_4)
anyTrue = List.AnyTrue(list=transpose_4@L2)
filterByBoolMask_2 = List.FilterByBoolMask(list=filterByBoolMask.out, mask=anyTrue)
code_block_8 = CodeBlock { 0; 1; }
getItemAtIndex_7 = List.GetItemAtIndex(list=filterByBoolMask_2.out@L2, index=code_block_8.out0)
getItemAtIndex_8 = List.GetItemAtIndex(list=filterByBoolMask_2.out@L2, index=code_block_8.out1)
byStartPointEndPoint = Line.ByStartPointEndPoint(startPoint=getItemAtIndex_7, endPoint=getItemAtIndex_8)
tsplinesurface_buildpipes = DoubleSlider(0.8, range=0.1..5 step 0.1)  # "TSplineSurface.BuildPipes defaultRadius"
buildPipes = TSpline.TSplineSurface.BuildPipes(curves=byStartPointEndPoint, defaultRadius=tsplinesurface_buildpipes)
